# Grasshopper definition surface panelization.gh (Grasshopper 1.0.8)

number_slider = Slider(29, range=0..30)  # disabled
number_slider_2 = Slider(3, range=0..10)  # disabled
number_slider_3 = Slider(0.6, range=0..1)  # disabled
number_slider_4 = Slider(0, range=0..100)  # disabled
number_slider_5 = Slider(1, range=0..1)  # disabled
number_slider_6 = Slider(10, range=0..10)
number_slider_7 = Slider(30, range=0..100)
number_slider_8 = Slider(10, range=0..10)  # disabled
number_slider_9 = Slider(30, range=0..100)  # disabled
srf = Surface(<surface referenced from the Rhino model>)
srf_2 = Surface(<surface referenced from the Rhino model>)  # disabled
surface_generator = Python3Script(
    base_surface=srf,
    divU=number_slider_7,
    divV=number_slider_7,
    amplitude=Slider(29, range=0..30),
    frequency=Slider(3, range=0..10),
    phase=Slider(0.6, range=0..1),
    seed=Slider(1, range=0..1),
    lift=Slider(0, range=0..100))  # -> out_surface, out_srf_id, out_points; inputs base_surface: Surface, divU: Int32, divV: Int32, amplitude: Double, frequency: Double, phase: Double, seed: Int32, lift: Double
# ---------- surface_generator: Python ----------
#r: numpy
import Rhino.Geometry as rg
import rhinoscriptsyntax as rs
import Rhino
import numpy as np
import random
import math
import System

# ------------------------------------------------------------
# Unwrap/coerce base_surface to RhinoCommon surface/face
# ------------------------------------------------------------
srf = getattr(base_surface, "Geometry", base_surface)

if srf is None:
    out_surface = None
    out_points = []
    srf_id = None
else:
    # If Brep, take first face
    if isinstance(srf, rg.Brep):
        if srf.Faces.Count == 0:
            out_surface = None
            out_points = []
            srf_id = None
        else:
            srf = srf.Faces[0]

    if not isinstance(srf, (rg.Surface, rg.BrepFace)):
        out_surface = None
        out_points = []
        srf_id = None
    else:
        # ------------------------------------------------------------
        # Seed
        # ------------------------------------------------------------
        if seed is not None:
            random.seed(seed)
            np.random.seed(seed)

        divU = int(divU)
        divV = int(divV)

        # Need at least 4x4 points for degree-3 surfaces
        uCount = max(4, divU + 1)
        vCount = max(4, divV + 1)

        # Clamp degrees so they never violate the function contract
        deg_u = min(3, uCount - 1)
        deg_v = min(3, vCount - 1)

        # ------------------------------------------------------------
        # Normalized UV grid
        # ------------------------------------------------------------
        Uu, Vv = np.meshgrid(
            np.linspace(0.0, 1.0, uCount),
            np.linspace(0.0, 1.0, vCount),
            indexing="xy"
        )

        # ------------------------------------------------------------
        # Heightmap (wave + bump)
        # ------------------------------------------------------------
        wave = np.sin(2.0 * math.pi * float(frequency) * (Uu + Vv) + float(phase))
        cx, cy = 0.5, 0.5
        dist = np.sqrt((Uu - cx) ** 2 + (Vv - cy) ** 2)
        bump = np.exp(-5.0 * dist ** 2)
        H = float(amplitude) * (0.6 * wave + 0.4 * bump)

        # ------------------------------------------------------------
        # Map normalized UV to surface domain, sample points + normals
        # ------------------------------------------------------------
        dom_u = srf.Domain(0)
        dom_v = srf.Domain(1)

        out_points = []   # Point3d list for GH visibility/debug
        pts_for_rs = []   # tuple list for AddSrfPtGrid

        for v_i in range(vCount):
            for u_i in range(uCount):
                u = dom_u.T0 + float(Uu[v_i, u_i]) * (dom_u.T1 - dom_u.T0)
                v = dom_v.T0 + float(Vv[v_i, u_i]) * (dom_v.T1 - dom_v.T0)

                p = srf.PointAt(u, v)
                n = srf.NormalAt(u, v)
                if n.IsTiny():
                    n = rg.Vector3d(0, 0, 1)
                else:
                    n.Unitize()

                d = float(H[v_i, u_i])
                pp = rg.Point3d(
                    p.X + n.X * d,
                    p.Y + n.Y * d,
                    p.Z + n.Z * d + float(lift)
                )

                out_points.append(pp)
                pts_for_rs.append((pp.X, pp.Y, pp.Z))

        # ------------------------------------------------------------
        # Create surface using RhinoScriptSyntax (returns guid on success)
        # ------------------------------------------------------------
        srf_id = rs.AddSrfPtGrid(
            (uCount, vCount),
            pts_for_rs,
            degree=(deg_u, deg_v),
            closed=(False, False)
        )

        # ------------------------------------------------------------
        # Convert guid -> real geometry for Grasshopper preview
        # RhinoDoc.ActiveDoc.Objects.FindId(guid) returns the RhinoObject. :contentReference[oaicite:4]{index=4}
        # ------------------------------------------------------------
        out_surface = None
        if srf_id:
            # Ensure we have a System.Guid
            if isinstance(srf_id, str):
                gid = System.Guid(srf_id)
            else:
                gid = srf_id

            rh_obj = Rhino.RhinoDoc.ActiveDoc.Objects.FindId(gid)
            if rh_obj:
                # DuplicateGeometry gives GH a safe copy
                out_surface = rh_obj.Geometry.Duplicate()
# ---------- end surface_generator ----------
surface_generator_2 = Python3Script(
    base_surface=srf_2,
    divU=number_slider_9,
    divV=number_slider_9,
    amplitude=number_slider,
    frequency=number_slider_2,
    phase=number_slider_3,
    seed=number_slider_5,
    lift=number_slider_4)  # -> out_surface, out_srf_id, out_points; inputs base_surface: Surface, divU: Int32, divV: Int32, amplitude: Double, frequency: Double, phase: Double, seed: Int32, lift: Double; disabled; same code as surface_generator
number_slider_10 = Slider(31, range=0..100)  # disabled
pt = Point(surface_generator.out_points)
pt_2 = Point(surface_generator_2.out_points)  # disabled
srfgrid = SurfaceFromPoints(Points=pt, UCount=Slider(31, range=0..100), Interpolate=False)
srfgrid_2 = SurfaceFromPoints(Points=pt_2, UCount=number_slider_10, Interpolate=False)  # disabled
number_slider_11 = Slider(5, range=0..10)  # disabled
agent_builder = Python3Script(N="100", reset=Button(), base_surface=srfgrid, max_speed=Slider(8, range=0..10))  # -> x
# ---------- agent_builder: Python ----------
"""
Assignment 4: Agent-Based Model for Surface Panelization

Author: Your Name

Agent Builder Template
"""

# -----------------------------------------------------------------------------
# Imports
# -----------------------------------------------------------------------------
import rhinoscriptsyntax as rs
import random
import numpy as np
import Rhino
import Rhino.Geometry as rg

# -----------------------------------------------------------------------------
# Utility
# -----------------------------------------------------------------------------
def seed_everything(seed):
    if seed is None:
        return
    try:
        s = int(seed)
    except:
        return
    random.seed(s)
    np.random.seed(s)

# -----------------------------------------------------------------------------
# Agent
# -----------------------------------------------------------------------------
class Agent:
    """Represents a single agent with position, velocity, and state."""

    def __init__(self, position, velocity):
        self.position = position          # Point3d (public)
        self.velocity = velocity          # Vector3d (public)

        self.uv = None                    # Point2d (internal)
        self.uv_velocity = None           # Vector2d (internal)
        self.surface = None

        self.max_speed = 0.02
        self.noise = 0.003
        self.age = 0

        # sensed values
        self.nearest_dist = None
        self.nearest_vec = None
        self.curv_dir = None              # Vector3d
        self.curv_mag = 0.0

    # -------------------------------------------------------------------------
    # SENSE
    # -------------------------------------------------------------------------
    def sense(self, agents):
        """Sense neighbors and surface curvature."""
        # --- neighbor sensing ---
        self.nearest_dist = None
        self.nearest_vec = None

        for other in agents:
            if other is self:
                continue
            d = self.position.DistanceTo(other.position)
            if self.nearest_dist is None or d < self.nearest_dist:
                self.nearest_dist = d
                v = rg.Vector3d(self.position - other.position)
                if v.Length > 1e-9:
                    v.Unitize()
                self.nearest_vec = v

        # --- curvature sensing ---
        self.curv_dir = None
        self.curv_mag = 0.0

        if self.surface is None or self.uv is None:
            return

        try:
            sc = self.surface.CurvatureAt(self.uv.X, self.uv.Y)
            if sc is None:
                return

            k0 = abs(sc.Kappa(0))
            k1 = abs(sc.Kappa(1))

            d0 = sc.Direction(0)
            d1 = sc.Direction(1)

            # choose minimum curvature direction (panel-friendly)
            if k0 <= k1:
                self.curv_dir = d0
                self.curv_mag = k0
            else:
                self.curv_dir = d1
                self.curv_mag = k1

            if self.curv_dir is not None and self.curv_dir.Length > 1e-9:
                self.curv_dir.Unitize()
            else:
                self.curv_dir = None

        except:
            self.curv_dir = None
            self.curv_mag = 0.0

    # -------------------------------------------------------------------------
    # DECIDE
    # -------------------------------------------------------------------------
    def decide(self):
        """Blend curvature following and spacing repulsion."""
        if self.uv_velocity is None:
            self.uv_velocity = rg.Vector2d(self.max_speed, 0.0)

        # weights
        target_spacing = 1.0
        repel_gain = 0.01
        curv_gain = 0.02

        du = self.surface.Domain(0)
        dv = self.surface.Domain(1)

        # --- curvature following ---
        if self.curv_dir is not None:
            eps = 0.01 * (du.T1 - du.T0)
            pu = self.surface.PointAt(min(du.T1, self.uv.X + eps), self.uv.Y)
            pv = self.surface.PointAt(self.uv.X, min(dv.T1, self.uv.Y + eps))

            tu = pu - self.position
            tv = pv - self.position

            cu = rg.Vector3d.Multiply(self.curv_dir, tu)
            cv = rg.Vector3d.Multiply(self.curv_dir, tv)

            self.uv_velocity.X += curv_gain * cu
            self.uv_velocity.Y += curv_gain * cv

        # --- neighbor repulsion ---
        if self.nearest_dist is not None and self.nearest_dist < target_spacing:
            eps = 0.01 * (du.T1 - du.T0)
            pu = self.surface.PointAt(min(du.T1, self.uv.X + eps), self.uv.Y)
            pv = self.surface.PointAt(self.uv.X, min(dv.T1, self.uv.Y + eps))

            tu = pu - self.position
            tv = pv - self.position

            ru = rg.Vector3d.Multiply(self.nearest_vec, tu)
            rv = rg.Vector3d.Multiply(self.nearest_vec, tv)

            self.uv_velocity.X += repel_gain * ru
            self.uv_velocity.Y += repel_gain * rv

        # --- noise ---
        self.uv_velocity.X += random.uniform(-1.0, 1.0) * self.noise
        self.uv_velocity.Y += random.uniform(-1.0, 1.0) * self.noise

        # clamp speed
        sp = (self.uv_velocity.X**2 + self.uv_velocity.Y**2) ** 0.5
        if sp > self.max_speed:
            self.uv_velocity.X = (self.uv_velocity.X / sp) * self.max_speed
            self.uv_velocity.Y = (self.uv_velocity.Y / sp) * self.max_speed

    # -------------------------------------------------------------------------
    # MOVE
    # -------------------------------------------------------------------------
    def move(self):
        if self.surface is None or self.uv is None:
            return

        du = self.surface.Domain(0)
        dv = self.surface.Domain(1)

        u = max(du.T0, min(du.T1, self.uv.X + self.uv_velocity.X))
        v = max(dv.T0, min(dv.T1, self.uv.Y + self.uv_velocity.Y))

        prev = self.position

        self.uv = rg.Point2d(u, v)
        self.position = self.surface.PointAt(u, v)
        self.velocity = rg.Vector3d(self.position - prev)

        self.age += 1

    # -------------------------------------------------------------------------
    # UPDATE
    # -------------------------------------------------------------------------
    def update(self, agents):
        self.sense(agents)
        self.decide()
        self.move()

# -----------------------------------------------------------------------------
# Factory
# -----------------------------------------------------------------------------
def build_agents(num_agents, initial_data=None):
    initial_data = initial_data or {}
    seed_everything(initial_data.get("seed", None))

    srf = initial_data.get("surface", None)
    srf_geo = getattr(srf, "Geometry", srf)

    try:
        import System
        if isinstance(srf_geo, System.Guid):
            srf_geo = rs.coercesurface(srf_geo)
    except:
        pass

    if isinstance(srf_geo, rg.Brep) and srf_geo.Faces.Count > 0:
        srf_geo = srf_geo.Faces[0]

    du = srf_geo.Domain(0)
    dv = srf_geo.Domain(1)

    max_speed = float(initial_data.get("max_speed", 0.02))

    agents = []
    for _ in range(int(num_agents)):
        u = random.uniform(du.T0, du.T1)
        v = random.uniform(dv.T0, dv.T1)

        ang = random.uniform(0.0, 2.0 * np.pi)
        spd = random.uniform(0.005, max_speed)

        a = Agent(srf_geo.PointAt(u, v), rg.Vector3d(0, 0, 0))
        a.surface = srf_geo
        a.uv = rg.Point2d(u, v)
        a.uv_velocity = rg.Vector2d(np.cos(ang) * spd, np.sin(ang) * spd)
        a.max_speed = max_speed

        agents.append(a)

    return agents

# -----------------------------------------------------------------------------
# Grasshopper stateful component
# -----------------------------------------------------------------------------
class MyComponent(Grasshopper.Kernel.GH_ScriptInstance):
    def RunScript(self, N, reset, base_surface, seed, max_speed):
        if reset or not hasattr(self, "agents"):
            init = {"seed": seed, "surface": base_surface, "max_speed": max_speed}
            self.agents = build_agents(N, initial_data=init)
        return self
# ---------- end agent_builder ----------
agent_builder_2 = Python3Script(base_surface=srfgrid_2, max_speed=number_slider_11)  # -> x; disabled
# ---------- agent_builder_2: Python ----------
"""
Assignment 4: Agent-Based Model for Surface Panelization

Author: Your Name

Agent Builder Template
"""

# -----------------------------------------------------------------------------
# Imports (extend as needed)
# -----------------------------------------------------------------------------
import rhinoscriptsyntax as rs
import random
import numpy as np
import Rhino
import Rhino.Geometry as rg

# -----------------------------------------------------------------------------
# Utility functions (optional)
# -----------------------------------------------------------------------------
def seed_everything(seed):
    """Set random seeds for reproducibility."""
    if seed is None:
        return
    try:
        s = int(seed)
    except:
        return
    random.seed(s)
    np.random.seed(s)

# -----------------------------------------------------------------------------
# Core agent class
# -----------------------------------------------------------------------------
class Agent:
    """Represents a single agent with position, velocity, and state."""

    def __init__(self, position, velocity):
        """
        Initialize the agent with position and velocity.

        Public (what simulator reads):
          position: rg.Point3d
          velocity: rg.Vector3d

        Internal:
          uv: rg.Point2d
          uv_velocity: rg.Vector2d
          surface: rg.Surface or rg.BrepFace
        """
        self.position = position
        self.velocity = velocity
        self.age = 0
        self.max_speed = 0.02
        self.noise = 0.003
        self._signals = None

        self.uv = None
        self.uv_velocity = None
        self.surface = None

    def sense(self, signals):
        """Read environmental signals relevant to the agent."""
        self._signals = signals

    def decide(self):
        """Decide on actions based on sensed information."""
        # Work in UV velocity internally
        if self.uv_velocity is None:
            self.uv_velocity = rg.Vector2d(self.max_speed, 0.0)

        self.uv_velocity.X += random.uniform(-1.0, 1.0) * self.noise
        self.uv_velocity.Y += random.uniform(-1.0, 1.0) * self.noise

        sp = (self.uv_velocity.X * self.uv_velocity.X + self.uv_velocity.Y * self.uv_velocity.Y) ** 0.5
        if sp < 1e-9:
            self.uv_velocity = rg.Vector2d(self.max_speed, 0.0)
            sp = self.max_speed
        if sp > self.max_speed:
            self.uv_velocity.X = (self.uv_velocity.X / sp) * self.max_speed
            self.uv_velocity.Y = (self.uv_velocity.Y / sp) * self.max_speed

    def move(self):
        """Update position according to velocity and rules."""
        if self.surface is None or self.uv is None:
            return

        du = self.surface.Domain(0)
        dv = self.surface.Domain(1)

        # Integrate UV
        u = self.uv.X + self.uv_velocity.X
        v = self.uv.Y + self.uv_velocity.Y

        # Clamp to domain
        if u < du.T0: u = du.T0
        if u > du.T1: u = du.T1
        if v < dv.T0: v = dv.T0
        if v > dv.T1: v = dv.T1

        prev_pos = self.position

        # Update internal UV
        self.uv = rg.Point2d(u, v)

        # Update public 3D position
        self.position = self.surface.PointAt(u, v)

        # Update public 3D velocity (delta)
        self.velocity = rg.Vector3d(self.position - prev_pos)

        self.age += 1

    def update(self, agents):
        """Perform one update cycle: sense, decide, and move."""
        self.sense(None)
        self.decide()
        self.move()

# -----------------------------------------------------------------------------
# Factory for creating agents
# -----------------------------------------------------------------------------
def build_agents(num_agents, initial_data=None):
    """Create and initialize a list of Agent instances."""
    initial_data = initial_data or {}
    seed_everything(initial_data.get("seed", None))

    du0, du1 = 0.0, 1.0
    dv0, dv1 = 0.0, 1.0

    srf = initial_data.get("surface", None)
    srf_geo = None

    # Try to read real surface domain if possible
    if srf is not None:
        try:
            srf_geo = getattr(srf, "Geometry", srf)
            try:
                import System
                if isinstance(srf_geo, System.Guid):
                    srf_geo = rs.coercesurface(srf_geo)
            except:
                pass

            if isinstance(srf_geo, rg.Brep) and srf_geo.Faces.Count > 0:
                srf_geo = srf_geo.Faces[0]

            if isinstance(srf_geo, (rg.Surface, rg.BrepFace)):
                du = srf_geo.Domain(0)
                dv = srf_geo.Domain(1)
                du0, du1 = du.T0, du.T1
                dv0, dv1 = dv.T0, dv.T1
            else:
                srf_geo = None
        except:
            srf_geo = None

    max_speed = initial_data.get("max_speed", 0.02)
    try:
        max_speed = float(max_speed) if max_speed is not None else 0.02
    except:
        max_speed = 0.02

    agents = []
    for _ in range(int(num_agents)):
        u = random.uniform(du0, du1)
        v = random.uniform(dv0, dv1)

        # Initial UV velocity
        ang = random.uniform(0.0, 2.0 * np.pi)
        spd = random.uniform(0.005, max_speed)
        uv_vel = rg.Vector2d(np.cos(ang) * spd, np.sin(ang) * spd)

        # Public 3D state
        if srf_geo is not None:
            pos3d = srf_geo.PointAt(u, v)
        else:
            pos3d = rg.Point3d(u, v, 0.0)
        vel3d = rg.Vector3d(0.0, 0.0, 0.0)

        a = Agent(pos3d, vel3d)

        # Attach internal surface + UV state
        a.surface = srf_geo
        a.uv = rg.Point2d(u, v)
        a.uv_velocity = uv_vel
        a.max_speed = max_speed

        agents.append(a)

    return agents

# -----------------------------------------------------------------------------
# Grasshopper script instance (structural placeholder)
# -----------------------------------------------------------------------------
class MyComponent(Grasshopper.Kernel.GH_ScriptInstance):
    """Manages persistent agent list across Grasshopper runs."""

    def RunScript(self, N, reset, base_surface, seed, max_speed):
        """
        Main entry point called by Grasshopper.
        """
        if reset or not hasattr(self, "agents"):
            init = {"seed": seed, "surface": base_surface, "max_speed": max_speed}
            self.agents = build_agents(N, initial_data=init)
        return self
# ---------- end agent_builder_2 ----------
agents_simulator = Python3Script(x=agent_builder)  # -> P, V
# ---------- agents_simulator: Python ----------
"""
Assignment 4: Agent-Based Model for Surface Panelization
Author: Your Name

Agent Simulator
"""

import rhinoscriptsyntax as rs

# -----------------------------------------------------------------------------
# Retrieve agents from upstream Grasshopper component
# -----------------------------------------------------------------------------
agents = None
if x is not None and hasattr(x, "agents"):
    agents = x.agents

# -----------------------------------------------------------------------------
# Step simulation (delegated to Agent methods)
# -----------------------------------------------------------------------------
if agents is not None:
    for agent in agents:
        agent.update(agents)

# -----------------------------------------------------------------------------
# Visualization
# -----------------------------------------------------------------------------
P = []
V = []

if agents is not None:
    for agent in agents:
        pos = agent.position
        vel = agent.velocity

        P.append(rs.AddPoint(pos.X, pos.Y, pos.Z))

        end = pos + vel
        V.append(rs.AddLine((pos.X, pos.Y, pos.Z), (end.X, end.Y, end.Z)))
# ---------- end agents_simulator ----------
agents_simulator_2 = Python3Script(x=agent_builder_2)  # -> P, V; disabled; same code as agents_simulator
